# Grasshopper definition DF.gh (Grasshopper 1.0.7)

brep = Brep(<brep referenced from the Rhino model>)
mesh = Mesh(brep)
bbox = BoundingBox(Content=mesh, Plane=PlaneXY(0, 0, 0))  # -> Box, Box_2
bbox_2 = BoundingBox(Content=bbox.Box, Plane=PlaneXY(0, 0, 0))  # -> Box, Box_2
debox = DeconstructBox(Box=bbox_2.Box)  # -> Plane, X, Y, Z
dedomain = DeconstructDomain(Domain=debox.Z)  # -> Start, End
number_slider = Slider(50, range=0..100)
subtraction = Subtraction(A=dedomain.End, B=dedomain.Start)
xy = XYPlane(Origin=Point(0, 0, 0))
Z = UnitZ(Factor=number_slider)
division = Division(A=subtraction, B=number_slider)
arrlinear = LinearArray(Geometry=xy, Direction=Z, Count=division)  # -> Geometry, Transform
sec = MeshPlane(Mesh=mesh, Plane=arrlinear.Geometry)  # -> flatten(Curves)
clean = CleanTree(RemoveNulls=True, RemoveInvalid=True, RemoveEmpty=True, Tree=sec)
lng = ListLength(List=clean)
panel = Panel(lng)
number_slider_2 = Slider(50, range=0..100)
reset = Button()
timer = Timer(TimerInterval=500, Target=rec)  # disabled
rec = DataRecorder(Slider(0.1, range=0..0.1), DataLimit=-10, RecordData=True)
cluster = Cluster(timer=rec, reset=reset, nozzle_radius=number_slider_2, L=clean, layer_number=Slider(0, range=0..100))  # -> now_radius, output, finish
cluster_2 = Cluster(timer=rec, reset=reset, nozzle_radius=number_slider_2, L=clean, layer_number=Slider(1, range=0..1))  # -> now_radius, output, finish
panel_2 = Panel(cluster.now_radius)
panel_3 = Panel(cluster.finish)
panel_4 = Panel(cluster_2.now_radius)
pline = PolyLine(Vertices=cluster.output, Closed=False)
pline_2 = PolyLine(Vertices=cluster_2.output, Closed=False)
entwine = Entwine(Branch00=flatten(pline), Branch01=flatten(pline_2), FlattenInputs=True)
clean_2 = CleanTree(RemoveNulls=True, RemoveInvalid=True, RemoveEmpty=True, Tree=entwine)
divide = DivideCurve(Curve=clean_2, Count=Slider(400, range=0..5000), Kinks=False)  # -> Points, Tangents, Parameters
intcrv = Interpolate(Vertices=divide.Points, Degree=3, Periodic=True, KnotStyle=1)  # -> Curve, Length, Domain

# ==== cluster Cluster
layer_number = ClusterInput()
timer = ClusterInput()
reset = ClusterInput()
nozzle_radius = ClusterInput()
number_slider = Slider(100, range=0..1000)
L = ClusterInput()
item = ListItem(List=L, Index=layer_number, Wrap=True)
offset = OffsetCurve(Curve=item, Distance=number_slider, Plane=PlaneXY(0, 0, 0), Corners=1)
cir = Circle(Plane=PlaneXY(0, 0, 0), Radius=nozzle_radius)
area = Area(Geometry=item)  # -> Area, Centroid
area_2 = Area(Geometry=offset)  # -> Area, Centroid
area_3 = Area(Geometry=cir)  # -> Area, Centroid
neg = Negative(Value=number_slider)
larger = LargerThan(FirstNumber=area.Area, SecondNumber=area_2.Area)  # -> LargerThan, OrEqualTo
division = Division(A=area.Area, B=area_3.Area)
p_n_c = PickNChoose(Pattern=larger.LargerThan, Stream0=neg, Stream1=number_slider)
offset_2 = OffsetCurve(Curve=item, Distance=p_n_c, Plane=PlaneXY(0, 0, 0), Corners=1)
multiplication = Multiplication(A=division, B=Slider(1.1, range=0..10))
divide = DivideCurve(Curve=offset_2, Count=multiplication, Kinks=False)  # -> Points, Tangents, Parameters
boundary = BoundarySurfaces(Edges=item)
on = BooleanToggle(False)
pline = PolyLine(Vertices=divide.Points, Closed=True)
item_2 = ListItem(List=divide.Points, Index=0, Wrap=True)
explode = Explode(Curve=pline, Recursive=True)  # -> Segments, Vertices
ma = MassAddition(Input=timer)  # -> Result, PartialResults
onmesh = OnMesh(Points=divide.Points, Mesh=boundary, Strength=100)
pdecon = Deconstruct(Point=item_2)  # -> XComponent, YComponent, ZComponent
len = Length(Curve=explode.Segments)
item_3 = ListItem(List=len, Index=0, Wrap=True)
addition = Addition(A=ma.Result, B=1)
pt = ConstructPoint(XCoordinate=0, YCoordinate=0, ZCoordinate=pdecon.ZComponent)
multiplication_2 = Multiplication(A=item_3, B=addition)
division_2 = Division(A=multiplication_2, B=2)
expression = Expression(x=division_2, y=nozzle_radius, Expression="If(x≤y, 0, 1)")
p_n_c_2 = PickNChoose(Pattern=expression, Stream0=Toggle(True), Stream1=on)  # -> flatten(Result)
sc = SphereCollide(Points=divide.Points, Radius=division_2, Strength=10)
anchor = Anchor(Point=item_2, Target=pt, Strength=10000)
finish = ClusterOutput(p_n_c_2)
now_radius = ClusterOutput(addition)
panel = Panel(addition)
length_line = LengthLine(Line=explode.Segments, Length=multiplication_2, Strength=1)
merge = Merge(Data1=flatten(onmesh), Data2=flatten(sc), Data3=flatten(length_line), Data4=flatten(anchor))  # -> flatten(Result)
panel_2 = Panel(multiplication_2)
solver = Solver(
    GoalObjects=flatten(merge),
    Reset=reset,
    Restart=False,
    Parallel=True,
    Threshold=1e-15,
    Tolerance=0.0001,
    AddCurrent=False,
    On=p_n_c_2)  # -> V, O
output = ClusterOutput(solver.V)
