# Grasshopper definition DG.gh (Grasshopper 1.0.7)

# ---- group: スライス対象
brep = Brep(<brep referenced from the Rhino model>)
mesh = Mesh(brep)

# ----
bbox = BoundingBox(Content=mesh, Plane=PlaneXY(0, 0, 0))  # -> Box, Box_2
bbox_2 = BoundingBox(Content=bbox.Box, Plane=PlaneXY(0, 0, 0))  # -> Box, Box_2
debox = DeconstructBox(Box=bbox_2.Box)  # -> Plane, X, Y, Z

# ---- group: スライスピッチ
number_slider = Slider(50, range=0..100)

# ---- group: ファーストレイヤー係数
number_slider_2 = Slider(0.8, range=0..1)

# ----
dedomain = DeconstructDomain(Domain=debox.Z)  # -> Start, End
subtraction = Subtraction(A=dedomain.End, B=dedomain.Start)
division = Division(A=subtraction, B=number_slider)
multiplication = Multiplication(A=number_slider, B=number_slider_2)
addition = Addition(A=division, B=100)
series = Series(Start=multiplication, Step=number_slider, Count=addition)
xy = XYPlane(Origin=Point(0, 0, 0))
Z = UnitZ(Factor=series)
move = Move(Geometry=xy, Motion=Z)  # -> Geometry, Transform
sec = MeshPlane(Mesh=mesh, Plane=move.Geometry)  # -> flatten(Curves)
clean = CleanTree(RemoveNulls=True, RemoveInvalid=True, RemoveEmpty=True, Tree=sec)
lng = ListLength(List=clean)
レイヤー数 = Panel(lng)
panel = Panel("一層だけだとバグが出るので二層以上で実行してください......")

# ---- group: 何層目から何層
series_2 = Series(Start=Slider(1, range=0..100), Step=1, Count=Slider(2, range=0..100))

# ---- group: タイマー系操作
reset = Button()
timer = Timer(TimerInterval=500, Target=rec)  # disabled
rec = DataRecorder(Slider(0.1, range=0..0.1), DataLimit=-10, RecordData=True)

# ----
subtraction_2 = Subtraction(A=series_2, B=1)

# ---- group: 各層の始点終点
item = ListItem(List=clean, Index=subtraction_2, Wrap=True)
end = EndPoints(Curve=item)  # -> Start, End
pdecon = Deconstruct(Point=end.Start)  # -> XComponent, YComponent, ZComponent
pt = ConstructPoint(XCoordinate=0, YCoordinate=0, ZCoordinate=pdecon.ZComponent)

# ----
cluster = Cluster(
    timer=rec,
    reset=reset,
    nozzle_radius=Slider(50, range=0..100),
    L=clean,
    layer_number=subtraction_2,
    anchor_point_start=pt,
    anchor_point_end=pt)  # -> output, now_radius, finish
panel_2 = Panel(cluster.now_radius)

# ---- group: 各レイヤー処理終了判定
panel_3 = Panel(cluster.finish)

# ----
pline = PolyLine(Vertices=simplify(cluster.output), Closed=True)
entwine = Entwine(Branch00=flatten(pline), FlattenInputs=True)

# ---- group: フィレット具合
number_slider_3 = Slider(1350, range=0..5000)

# ----
clean_2 = CleanTree(RemoveNulls=True, RemoveInvalid=True, RemoveEmpty=True, Tree=entwine)
divide = DivideCurve(Curve=clean_2, Count=number_slider_3, Kinks=False)  # -> Points, Tangents, Parameters
intcrv = Interpolate(Vertices=divide.Points, Degree=3, Periodic=True, KnotStyle=1)  # -> Curve, Length, Domain

# ---- group: アウトプット
crv = Curve(intcrv.Curve)

# ==== cluster Cluster
layer_number = ClusterInput()
timer = ClusterInput()
reset = ClusterInput()
nozzle_radius = ClusterInput()
number_slider = Slider(100, range=0..1000)
L = ClusterInput()
item = ListItem(List=L, Index=layer_number, Wrap=True)
offset = OffsetCurve(Curve=item, Distance=number_slider, Plane=PlaneXY(0, 0, 0), Corners=1)  # -> flatten(Curve)
cir = Circle(Plane=PlaneXY(0, 0, 0), Radius=nozzle_radius)
area = Area(Geometry=item)  # -> Area, Centroid
area_2 = Area(Geometry=offset)  # -> Area, Centroid
area_3 = Area(Geometry=cir)  # -> Area, Centroid
neg = Negative(Value=number_slider)
larger = LargerThan(FirstNumber=area.Area, SecondNumber=area_2.Area)  # -> graft(LargerThan), OrEqualTo
division = Division(A=area.Area, B=area_3.Area)
p_n_c = PickNChoose(Pattern=larger.LargerThan, Stream0=neg, Stream1=number_slider)  # -> flatten(Result)
offset_2 = OffsetCurve(Curve=item, Distance=p_n_c, Plane=PlaneXY(0, 0, 0), Corners=1)
multiplication = Multiplication(A=division, B=Slider(1.1, range=0..10))
divide = DivideCurve(Curve=flatten(offset_2), Count=multiplication, Kinks=False)  # -> Points, Tangents, Parameters
boundary = BoundarySurfaces(Edges=item)  # -> graft(Surfaces)
on = BooleanToggle(False)
pline = PolyLine(Vertices=divide.Points, Closed=True)
anchor_point_start = ClusterInput()
anchor_point_end = ClusterInput()
item_2 = ListItem(List=divide.Points, Index=[0, -1], Wrap=True)
explode = Explode(Curve=pline, Recursive=True)  # -> Segments, Vertices
onmesh = OnMesh(Points=simplify(divide.Points), Mesh=simplify(boundary), Strength=100)  # -> simplify(P)
ma = MassAddition(Input=timer)  # -> Result, PartialResults
len = Length(Curve=explode.Segments)
merge = Merge(Data1=graft(anchor_point_start), Data2=graft(anchor_point_end))  # -> simplify(Result)
item_3 = ListItem(List=len, Index=0, Wrap=True)
addition = Addition(A=ma.Result, B=1)
multiplication_2 = Multiplication(A=item_3, B=addition)
division_2 = Division(A=multiplication_2, B=2)
expression = Expression(x=division_2, y=nozzle_radius, Expression="If(x≤y, 0, 1)")
now_radius = ClusterOutput(division_2)
p_n_c_2 = PickNChoose(Pattern=expression, Stream0=Toggle(True), Stream1=on)  # -> simplify(Result)
sc = SphereCollide(Points=divide.Points, Radius=division_2, Strength=10)  # -> simplify(S)
equals = Equality(FirstNumber=p_n_c_2, SecondNumber="True")  # -> Equality, Inequality
anchor = Anchor(Point=item_2, Target=merge, Strength=10000)  # -> simplify(A)
panel = Panel(addition)
length_line = LengthLine(Line=explode.Segments, Length=multiplication_2, Strength=1)  # -> simplify(Spring)
finish = ClusterOutput(equals.Inequality)
lng = ListLength(List=layer_number)
merge_2 = Merge(Data1=onmesh, Data2=sc, Data3=length_line, Data4=anchor)
lng_2 = ListLength(List=divide.Points)  # -> flatten(Length)
series = Series(Start=0, Step=1, Count=lng)
dup = DuplicateData(Data=reset, Number=lng, Order=True)  # -> simplify(graft(Data))
split = SplitList(List=lng_2, Index=series)  # -> simplify(ListA), ListB
panel_2 = Panel(lng_2)
solver = Solver(
    GoalObjects=merge_2,
    Reset=dup,
    Restart=False,
    Parallel=True,
    Threshold=1e-15,
    Tolerance=0.0001,
    AddCurrent=False,
    On=p_n_c_2)  # -> V, O
merge_3 = Merge(Data1=0, Data2=split.ListA)
ma_2 = MassAddition(Input=lng_2)  # -> Result, PartialResults
ma_3 = MassAddition(Input=merge_3)  # -> Result, PartialResults
merge_4 = Merge(Data1=flatten(ma_3.Result), Data2=flatten(ma_2.Result))
shift = ShiftList(List=merge_4, Shift=1, Wrap=True)  # -> simplify(graft(List))
subtraction = Subtraction(A=shift, B=1)
dom = ConstructDomain(DomainStart=ma_3.Result, DomainEnd=subtraction)
cull_i = CullIndex(List=flatten(dom), Indices=-1, Wrap=True)  # -> simplify(graft(List))
clean = CleanTree(RemoveNulls=True, RemoveInvalid=True, RemoveEmpty=True, Tree=cull_i)
subset = SubList(List=solver.V, Domain=clean, Wrap=True)  # -> simplify(List), Index
output = ClusterOutput(subset.List)
