# Grasshopper definition GcodeMaker_shatter.gh (Grasshopper 1.0.7)

# ---- group: サンプル
number_slider = Slider(50, range=0..100)
number_slider_2 = Slider(500, range=0..100000)
multiplication = Multiplication(A=Slider(0.8, range=0..1), B=number_slider)
series = Series(Start=multiplication, Step=number_slider, Count=Slider(10, range=0..10))
division = Division(A=number_slider_2, B=2)
neg = Negative(Value=division)
rectangle = Rectangle(Plane=PlaneXY(0, 0, 0), XSize=number_slider_2, YSize=number_slider_2, Radius=0)  # -> Rectangle, Length
vec = VectorXYZ(XComponent=neg, YComponent=neg, ZComponent=series)  # -> Vector, Length
move = Move(Geometry=rectangle.Rectangle, Motion=vec.Vector)  # -> Geometry, Transform
end = EndPoints(Curve=move.Geometry)  # -> Start, End
shift = ShiftList(List=end.Start, Shift=1, Wrap=True)
ln = Line(StartPoint=end.Start, EndPoint=shift)
cull_i = CullIndex(List=ln, Indices=-1, Wrap=True)
weave = Weave(Pattern=[0, 1], Stream0=move.Geometry, Stream1=cull_i, NullGaps=False)

# ---- group: curveのリスト
crv = Curve(weave)

# ----
clean = CleanTree(RemoveNulls=True, RemoveInvalid=True, RemoveEmpty=True, Tree=crv)

# ---- group: スピード(mm/min)
number_slider_3 = Slider(1000, range=0..10000)

# ----
merge = Merge(Data2=clean)
panel = Panel("mm/0.1sec")
division_2 = Division(A=number_slider_3, B="600")

# ---- group: スタート地点への移動と分割
end_2 = EndPoints(Curve=clean)  # -> Start, End
pt = ConstructPoint(XCoordinate=0, YCoordinate=0, ZCoordinate=Slider(5, range=0..10))
item = ListItem(List=flatten(end_2.Start), Index=0, Wrap=True)
pt_2 = Point(pt)
ln_2 = Line(StartPoint=pt_2, EndPoint=item)
merge_2 = Merge(Data1=ln_2)
end_3 = EndPoints(Curve=merge_2)  # -> Start, graft(End)
divdist = DivideDistance(Curve=merge_2, Distance=division_2)  # -> Points, Tangents, Parameters
merge_3 = Merge(Data1=divdist.Points, Data2=end_3.End)
bang = ExplodeTree(Data=merge_3)  # -> Branch0, Branch1
lng = ListLength(List=bang.Branch0)

# ----
end_4 = EndPoints(Curve=merge)  # -> Start, graft(End)
points = PointList(Points=flatten(end_4.End), Size=Slider(14, range=0..100))
panel_2 = Panel(end_4.End)
divdist_2 = DivideDistance(Curve=merge, Distance=division_2)  # -> simplify(Points), Tangents, Parameters
merge_4 = Merge(Data1=simplify(divdist_2.Points), Data2=simplify(end_4.End))
panel_3 = Panel("""True
False""")
flip = FlipMatrix(Data=divdist_2.Points)
cull = CullPattern(List=flip, CullPattern=panel_3)
flip_2 = FlipMatrix(Data=cull)
item_2 = ListItem(List=flip_2, Index=0, Wrap=True)
pt_3 = Point(flatten(merge_4))
merge_5 = Merge(Data1=flatten(merge_3), Data2=flatten(pt_3))

# ---- group: 吐出速度
number_slider_4 = Slider(100, range=0..500)

# ----
dup = DuplicateData(Data=Slider(0, range=0..100), Number=lng, Order=True)

# ---- group: スタート地点での待機時間(sec)
number_slider_5 = Slider(60, range=0..100)

# ----
multiplication_2 = Multiplication(A=number_slider_5, B=10)
dup_2 = DuplicateData(Data="G1 E500", Number=multiplication_2, Order=True)

# ---- group: ファイル書き出し場所
path = FilePath("C:\Users\negus\Desktop\")

# ---- group: 書き出しボタン
button = Button()

# ---- group: ファイル名
panel_4 = Panel("print-f.gcode")

# ----
panel_5 = Panel(path)

# ---- group: points distance
lng_2 = ListLength(List=pt_3)

# ----
subtraction = Subtraction(A=lng_2, B=1)

# ---- group: points distance (continued)
series_2 = Series(Start=0, Step=1, Count=subtraction)
item_3 = ListItem(List=pt_3, Index=series_2, Wrap=True)  # -> Item, Item1
dist = Distance(PointA=item_3.Item, PointB=item_3.Item1)

# ----
bnd = Bounds(Numbers=dist)
dedomain = DeconstructDomain(Domain=bnd)  # -> Start, End
division_3 = Division(A=dist, B=dedomain.End)
dup_3 = DuplicateData(Data=number_slider_4, Number=lng_2, Order=True)  # -> flatten(Data)
multiplication_3 = Multiplication(A=dup_3, B=division_3)
merge_6 = Merge(Data1=flatten(dup), Data2=flatten(multiplication_3))
python = PythonScript(
    Points=flatten(merge_5),
    Extrude=flatten(merge_6),
    List_Length=flatten(lng_2),
    speed=number_slider_3,
    layer_start_points=flatten(item_2),
    bool=True)  # -> flatten(Gcode), flatten(test); inputs Points: list of Point3d, Extrude: list of Int32, List_Length: list, layer_start_points: list of Point3d, bool: Boolean
# ---------- python: Python ----------
__author__ = "neguse"

import rhinoscriptsyntax as rs


if bool:
    Gcode = []

    for i in range(len(Points)):
        x = round(Points[i].X,2)
        y = round(Points[i].Y,2)
        z = 1*round(Points[i].Z,2)
        
        '''
        #レイヤー最初の一歩
        for t in layer_start_points:
            if t.X == Points[i].X and t.Y == Points[i].Y and t.Z == Points[i].Z:
                Gcode.append("M915 D90 Z0".format())
        '''
        
        #通常吐出
        if Extrude[i] != 0:
            Gcode.append("G1 X{} Y{} Z{} E{}".format(x,y,z,Extrude[i]))
        
        #最初の一歩
        elif i == 0:
            Gcode.append("G1 X{} Y{} Z{}".format(x,y,z))
            Gcode.append("G1 F{}".format(speed))
        
        #吐出なし
        else:
            Gcode.append("G1 X{} Y{} Z{}".format(x,y,z))

        test = Extrude[0]
# ---------- end python ----------
panel_6 = Panel(python.Gcode)
ins = InsertItems(List=python.Gcode, Item=dup_2, Indices=lng, Wrap=True)
merge_7 = Merge(Data1=flatten("M999"), Data2=flatten(ins))
python_2 = PythonScript(FileName=panel_4, Gcode=merge_7, Path=path, bool=button)  # inputs Gcode: list
# ---------- python_2: Python ----------
__author__ = "neguse"

import rhinoscriptsyntax as rs

Gcode ='\n'.join(Gcode)

if bool:
	file = open(Path + FileName, 'w')
	file.writelines(Gcode)
	file.close()
# ---------- end python_2 ----------
