# Grasshopper definition GcodeMaker_shatter_ver2.gh (Grasshopper 1.0.7)
# plug-ins: Telepathy

move = Move(Motion=Vector(0, 0, 10))  # -> Geometry, Transform
number_slider = Slider(1000, range=0..10000)
end = EndPoints(Curve=move.Geometry)  # -> Start, End
panel = Panel("mm/min")
division = Division(A=number_slider, B="600")
panel_2 = Panel("mm/0.1sec")
speed = RemoteSender(number_slider)
shift = ShiftList(List=end.Start, Shift=1, Wrap=True)
ln = Line(StartPoint=end.Start, EndPoint=shift)
divide_distance = RemoteSender(division)
divide_distance_2 = RemoteReceiver(divide_distance)
divdist = DivideDistance(Curve=move.Geometry, Distance=divide_distance_2)  # -> simplify(Points), Tangents, Parameters
cull_i = CullIndex(List=ln, Indices=-1, Wrap=True)
pt = ConstructPoint(XCoordinate=0, YCoordinate=0, ZCoordinate=Slider(20, range=0..50))
item = ListItem(List=flatten(divdist.Points), Index=0, Wrap=True)
pt_2 = Point(pt)
shift_2 = ShiftList(List=divdist.Points, Shift=1, Wrap=True)
ln_2 = Line(StartPoint=pt_2, EndPoint=item)
merge = Merge(Data1=flatten(ln_2), Data2=flatten(cull_i))
divide_distance_3 = RemoteReceiver(divide_distance)
cull_i_2 = CullIndex(List=shift_2, Indices=-1, Wrap=True)
divdist_2 = DivideDistance(Curve=merge, Distance=divide_distance_3)  # -> simplify(Points), Tangents, Parameters
dist = Distance(PointA=divdist.Points, PointB=cull_i_2)
multiplication = Multiplication(A=dist, B=Slider(200, range=0..500))  # -> simplify(Result)
lng = ListLength(List=divdist_2.Points)
speed_2 = RemoteReceiver(speed)
dup = DuplicateData(Data=Slider(0, range=0..100), Number=lng, Order=True)
python = PythonScript(Points=divdist.Points, Extrude=multiplication, speed=speed_2, bool=True)  # -> flatten(Gcode), flatten(test); inputs Points: tree of Point3d, Extrude: tree of Int32, List_Length: list, layer_start_points: list of Point3d, bool: Boolean
# ---------- python: Python ----------
__author__ = "neguse"

import rhinoscriptsyntax as rs

if bool:
    Gcode = []
    for i in range(Points.BranchCount):
        Gcode_block = []
        
        for t in range(len(Points.Branch(i))):
            
            x = round(Points.Branch(i)[t].X,2)
            y = round(Points.Branch(i)[t].Y,2)
            z = round(Points.Branch(i)[t].Z,2)
        
            #通常吐出
            if Extrude.Branch(i)[t] != 0:
                Gcode_block.append("G1 X{} Y{} Z{} E{}".format(x,y,z,Extrude.Branch(i)[t]))
            
            #吐出なし
            else:
                Gcode_block.append("G1 X{} Y{} Z{}".format(x,y,z))
        
        Gcode.append(Gcode_block)
        
        

    '''
    for i in range(len(Points)):
        x = round(Points[i].X,2)
        y = round(Points[i].Y,2)
        z = 1*round(Points[i].Z,2)
        
        #通常吐出
        if Extrude[i] != 0:
            Gcode.append("G1 X{} Y{} Z{} E{}".format(x,y,z,Extrude[i]))
        
        #最初の一歩
        elif i == 0:
            Gcode.append("G1 X{} Y{} Z{}".format(x,y,z))
            Gcode.append("G1 F{}".format(speed))
        
        #吐出なし
        else:
            Gcode.append("G1 X{} Y{} Z{}".format(x,y,z))

        test = Extrude[0]
    '''
# ---------- end python ----------
speed_3 = RemoteReceiver(speed)
python_2 = PythonScript(Points=divdist_2.Points, Extrude=dup, speed=speed_3, bool=True)  # -> flatten(Gcode), flatten(test); inputs Points: tree of Point3d, Extrude: tree of Int32, List_Length: list, layer_start_points: list of Point3d, bool: Boolean; same code as python
c_script = CSharpScript(x=python.Gcode)  # -> out, simplify(A)
# ---------- c_script: C# ----------
A = x;
# ---------- end c_script ----------
c_script_2 = CSharpScript(x=python_2.Gcode)  # -> out, simplify(A); same code as c_script
viewer = ParamViewer(c_script_2.A)
number_slider_2 = Slider(20, range=0..50)
viewer_2 = ParamViewer(python_2.Gcode)
branch = TreeBranch(Tree=c_script.A, Path="{0}", MaintainPaths=True)
branch_2 = TreeBranch(Tree=c_script_2.A, Path="{0}", MaintainPaths=True)
panel_3 = Panel(c_script_2.A)
entwine = Entwine(Branch00=branch_2, Branch01=branch, FlattenInputs=True)  # -> flatten(Result)
lng_2 = ListLength(List=entwine)
division_2 = Division(A=lng_2, B=number_slider_2)
series = Series(Start=0, Step=number_slider_2, Count=division_2)
ins = InsertItems(List=entwine, Item="M915 D90 Z20 U", Indices=series, Wrap=True)  # -> flatten(List)
panel_4 = Panel(ins)
path_mapper = PathMapper(c_script_2.A, source="{A}", target="{1+A*3}")
path_mapper_2 = PathMapper(c_script.A, source="{A}", target="{2+A*3}")
panel_5 = Panel(path_mapper)
number_slider_3 = Slider(1, range=0..1)
merge_2 = Merge(Data1=path_mapper_2, Data2=path_mapper)
viewer_3 = ParamViewer(path_mapper)
viewer_4 = ParamViewer(path_mapper_2)
tstat = TreeStatistics(Tree=merge_2)  # -> Paths, Length, Count
division_3 = Division(A=tstat.Count, B=2)
subtraction = Subtraction(A=division_3, B=number_slider_3)
dup_2 = DuplicateData(Data="M915 D90 Z20", Number=subtraction, Order=True)
dup_3 = DuplicateData(Data="M915 D90 Z0 U", Number=number_slider_3, Order=True)
merge_3 = Merge(Data1=flatten(dup_3), Data2=flatten(dup_2))  # -> simplify(graft(Result))
path_mapper_3 = PathMapper(merge_3, source="{A}", target="{A*3}")
viewer_5 = ParamViewer(path_mapper_3)
merge_4 = Merge(Data1=path_mapper_2, Data2=path_mapper, Data3=path_mapper_3)
viewer_6 = ParamViewer(merge_4)
python_3 = PythonScript(FileName="test4.gcode", Gcode=flatten(ins), Path="/Users/neguse/Desktop/", bool=Button())  # inputs Gcode: list
# ---------- python_3: Python ----------
__author__ = "neguse"

import rhinoscriptsyntax as rs

Gcode ='\n'.join(Gcode)

if bool:
	file = open(Path + FileName, 'w')
	file.writelines(Gcode)
	file.close()
# ---------- end python_3 ----------

pt_3 = Point()  # disabled
merge_5 = Merge(Data2=flatten(pt_3))  # disabled
number_slider_4 = Slider(200, range=0..500)  # disabled
panel_6 = Panel("等速時吐出割合")  # disabled
number_slider_5 = Slider(0, range=0..100)  # disabled
dup_4 = DuplicateData(Data=number_slider_5, Number=2, Order=True)  # disabled
number_slider_6 = Slider(30, range=0..100)  # disabled
panel_7 = Panel("待機時間 sec")  # disabled
multiplication_2 = Multiplication(A=number_slider_6, B=10)  # disabled
panel_8 = Panel("G1 E100")  # disabled
dup_5 = DuplicateData(Data=panel_8, Number=multiplication_2, Order=True)  # disabled

# ---- group: points distance
lng_3 = ListLength(List=pt_3)  # disabled

# ----
subtraction_2 = Subtraction(A=lng_3, B=1)  # disabled
dup_6 = DuplicateData(Data=number_slider_4, Number=lng_3, Order=True)  # -> flatten(Data); disabled

# ---- group: points distance (continued)
series_2 = Series(Start=0, Step=1, Count=subtraction_2)  # disabled
addition = Addition(A=series_2, B=1)  # disabled
item_2 = ListItem(List=pt_3, Index=series_2, Wrap=True)  # disabled
item_3 = ListItem(List=pt_3, Index=addition, Wrap=True)  # disabled
dist_2 = Distance(PointA=item_2, PointB=item_3)  # disabled

# ----
bnd = Bounds(Numbers=dist_2)  # disabled
dedomain = DeconstructDomain(Domain=bnd)  # -> Start, End; disabled
division_4 = Division(A=dist_2, B=dedomain.End)  # disabled
multiplication_3 = Multiplication(A=dup_6, B=division_4)  # disabled
merge_6 = Merge(Data1=flatten(dup_4), Data2=flatten(multiplication_3))  # disabled
python_4 = PythonScript(Points=flatten(merge_5), Extrude=flatten(merge_6), List_Length=flatten(lng_3), speed=number_slider, bool=True)  # -> flatten(Gcode), flatten(test); inputs Points: list of Point3d, Extrude: list of Int32, List_Length: list, layer_start_points: list of Point3d, bool: Boolean; disabled
# ---------- python_4: Python ----------
__author__ = "neguse"

import rhinoscriptsyntax as rs


if bool:
    Gcode = []

    for i in range(len(Points)):
        x = round(Points[i].X,2)
        y = round(Points[i].Y,2)
        z = 1*round(Points[i].Z,2)
        
        '''
        #レイヤー最初の一歩
        for t in layer_start_points:
            if t.X == Points[i].X and t.Y == Points[i].Y and t.Z == Points[i].Z:
                Gcode.append("M915 D90 Z0".format())
        '''
        
        #通常吐出
        if Extrude[i] != 0:
            Gcode.append("G1 X{} Y{} Z{} E{}".format(x,y,z,Extrude[i]))
        
        #最初の一歩
        elif i == 0:
            Gcode.append("G1 X{} Y{} Z{}".format(x,y,z))
            Gcode.append("G1 F{}".format(speed))
        
        #吐出なし
        else:
            Gcode.append("G1 X{} Y{} Z{}".format(x,y,z))

        test = Extrude[0]
# ---------- end python_4 ----------
ins_2 = InsertItems(List=python_4.Gcode, Item=dup_5, Wrap=True)  # disabled
merge_7 = Merge(Data2=ins_2)  # disabled
