# Grasshopper definition Project.gh (Grasshopper 1.0.7)
# plug-ins: Yellow

# ---- group: 投射元形状
mesh = Mesh(<mesh referenced from the Rhino model>)

# ---- group: Z0へ移動
bbox = BoundingBox(Content=mesh, Plane=PlaneXY(0, 0, 0))  # -> Box, Box_2
debox = DeconstructBox(Box=bbox.Box)  # -> Plane, X, Y, Z
dedomain = DeconstructDomain(Domain=debox.Z)  # -> Start, End
neg = Negative(Value=dedomain.Start)
vec = VectorXYZ(XComponent=0, YComponent=0, ZComponent=neg)  # -> Vector, Length
move = Move(Geometry=mesh, Motion=vec.Vector)  # -> Geometry, Transform

# ---- group: ボクセルサイズ
number_slider = Slider(7, range=0..10)

# ----
voxgeom = VoxelizeGeometry(Geometry=move.Geometry, Size=number_slider)  # -> flatten(Mesh)

# ---- group: データダム
toggle = BooleanToggle(True)

# ----
svoxels = SortVoxels(Voxels=voxgeom)
dispatch = Dispatch(List=svoxels, DispatchPattern=toggle)  # -> ListA, ListB
item = ListItem(List=dispatch.ListA, Index=0, Wrap=True)  # -> flatten(Item)
exvox2smhght = ExtendVoxels2SameHeight(Voxels=item, Direction="-Z", Distance=0)  # -> flatten(Voxels)
mergevox = MergeVoxel(Voxels=exvox2smhght)
smooth = Smooth(Mesh=mergevox, Strength=Slider(10, range=0..10))

# ---- group: アウトプット
mesh_2 = Mesh(smooth)

# ---- group: スライスのプレビュー
bbox_2 = BoundingBox(Content=smooth, Plane=PlaneXY(0, 0, 0))  # -> Box, Box_2
debox_2 = DeconstructBox(Box=bbox_2.Box)  # -> Plane, X, Y, Z
number_slider_2 = Slider(50, range=0..100)
dedomain_2 = DeconstructDomain(Domain=debox_2.Z)  # -> Start, End
pt = Point(Point(0, 0, 0))
subtraction = Subtraction(A=dedomain_2.End, B=dedomain_2.Start)
Z = UnitZ(Factor=number_slider_2)
division = Division(A=subtraction, B=number_slider_2)
addition = Addition(A=division, B=Slider(10, range=0..10))
arrlinear = LinearArray(Geometry=pt, Direction=Z, Count=addition)  # -> Geometry, Transform
pl = ConstructPlane(Origin=arrlinear.Geometry, XAxis=Vector(1, 0, 0), YAxis=Vector(0, 1, 0))
sec = MeshPlane(Mesh=smooth, Plane=pl)  # -> simplify(Curves)
clean = CleanTree(RemoveNulls=True, RemoveInvalid=True, RemoveEmpty=True, Tree=sec)  # -> simplify(Tree)
flip = FlipMatrix(Data=clean)
item_2 = ListItem(List=flip, Index=Slider(78, range=0..100), Wrap=True)
