# Grasshopper definition coc_150722_BrepAndCurves.gh (Grasshopper 0.9.76)
# plug-ins: MarchingCubes

number_slider = Slider(30, range=0..100)
crv = Curve(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)
srf = Surface(crv)
Z = UnitZ(Factor=Slider(10, range=3..60))
popgeo = PopulateGeometry(Geometry=srf, Count=number_slider, Seed=Slider(2, range=0..10))
dom = ConstructDomain(DomainStart=Slider(3, range=2..20), DomainEnd=Slider(25, range=2..30))
addition = Addition(A=popgeo, B=Z)
random = Random(Range=dom, Number=number_slider, Seed=Slider(6, range=0..10))
Z_2 = UnitZ(Factor=1)
dom_2 = ConstructDomain(DomainStart=Slider(2, range=2..20), DomainEnd=Slider(12, range=2..20))
line = LineSDL(Start=addition, Direction=expr("-x", Z_2), Length=random)
random_2 = Random(Range=dom_2, Number=number_slider, Seed=Slider(4, range=0..10))
curve_charge = CurveCharge(Curve=line, Radius=random_2, ChargeStrengths=Slider(-1, range=-2..2))
brep_charge = BrepCharge(Brep=srf, Radius=Slider(9.5, range=1..20), ChargeStrengths=Slider(1, range=-2..2))
merge = Merge(Data1=brep_charge, Data2=curve_charge)  # -> flatten(Result)
cocoon = Cocoon(Charges=merge, Iso=Slider(0.2, range=0..1), CellSize=Slider(2, range=0.5..10), Execute=Toggle(True), Simple=False)  # -> Mesh, RefinementData
refine = Refine(
    RefinementData=cocoon.RefinementData,
    Samples=Slider(15, range=0..30),
    SampleSize=Slider(0.25, range=0..2),
    SampleTolerance="0.01",
    LaplacianSmoothing=Slider(5, range=0..10),
    ValencePasses=Slider(3, range=0..10),
    SubD=Slider(2, range=0..3),
    Execute=Toggle(True))
preview = CustomPreview(
    Geometry=refine,
    Shader={ambient=RGB(128, 128, 128), diffuse=RGB(0, 0, 0), emission=RGB(51, 111, 111), shine=0.25, specular=RGB(255, 255, 255), transparency=0})
