# Grasshopper definition coc_150722_ComplexCurveDriver.gh (Grasshopper 0.9.76)
# plug-ins: MarchingCubes

number_slider = Slider(8, range=0..12)
pi = Pi(Factor=number_slider)
range = Range(Domain=pi, Steps=expr("x*2", number_slider))
crv = Curve([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])
neg = Negative(Value=range)
pframes = PerpFrames(Curve=crv, Count=expr("x*2", number_slider), Align=True)  # -> Frames, Parameters
entwine = Entwine(Branch00=range, Branch01=neg, FlattenInputs=True)
range_2 = Range(Domain=Domain(0, 1), Steps=Slider(50, range=0..100))
prot = RotatePlane(Plane=pframes.Frames, Angle=entwine)  # -> simplify(Plane)
graph = GraphMapper(
    range_2,
    x0=0,
    x1=1,
    y0=0,
    y1=1,
    container_name="Sine Summation",
    Equation0_px=[0.2, 0.2737993002],
    Equation0_py=[0.2, 0.375739038],
    Equation1_px=[0.4951552153, 0.8921658993],
    Equation1_py=[0, 0.4522271752])
pi_2 = Pi(Factor=Slider(8, range=0..12))
pt = PointOriented(BasePlane=prot, UComponent=Slider(4.46, range=1..10), VComponent=0, WComponent=0)
range_3 = Range(Domain=pi_2, Steps=Slider(50, range=0..100))
genes = GenePool(Decimals=2, Maximum=2, Minimum=0, Value=[1.52, 0.43, 1.52])
genes_2 = GenePool(Decimals=2, Maximum=2, Minimum=0, Value=[1.93, 0.98, 0.31])
shift = ShiftList(List=pt, Shift=Slider(2, range=0..10), Wrap=False)
sin = Sine(Value=range_3)
intcrv = Interpolate(Vertices=shift, Degree=3, Periodic=False, KnotStyle=1)  # -> Curve, Length, Domain
abs = Absolute(Value=sin)
curve_charge = CurveCharge(Curve=intcrv.Curve, Radius=Slider(2, range=1..30), ChargeStrengths=Slider(-1.48, range=-3..2))  # -> flatten(CurveCharge)
curve_charge_2 = CurveCharge(Curve=crv, Radius=Slider(7.5, range=0..20), ChargeStrengths=genes_2)
crv_2 = Curve(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)
curve_charge_3 = CurveCharge(Curve=crv_2, Radius=Slider(4, range=1..30), ChargeStrengths=genes)
crv_3 = Curve(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)
curve_charge_4 = CurveCharge(Curve=crv_3, Radius=Slider(14.38, range=1..30), ChargeStrengths=graph)
crv_4 = Curve(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)
curve_charge_5 = CurveCharge(Curve=crv_4, Radius=Slider(3.69, range=1..30), ChargeStrengths=Slider(-2, range=-3..0))
curve_charge_6 = CurveCharge(Curve=crv_4, Radius=Slider(9.18, range=1..30), ChargeStrengths=abs)
merge = Merge(
    Data1=curve_charge_3,
    Data2=curve_charge_4,
    Data3=curve_charge_5,
    Data4=curve_charge_6,
    Data5=curve_charge_2,
    Data6=curve_charge)  # -> flatten(Result)
execute = BooleanToggle(True)
cocoon = Cocoon(Charges=merge, Iso=Slider(0.25, range=0..1), CellSize=Slider(1.5, range=0.5..10), Execute=execute, Simple=False)  # -> Mesh, RefinementData
refine = Refine(
    RefinementData=cocoon.RefinementData,
    Samples=Slider(30, range=0..30),
    SampleSize=Slider(0.5, range=0..10),
    SampleTolerance="0.005",
    LaplacianSmoothing=Slider(2, range=0..10),
    ValencePasses=Slider(2, range=0..10),
    SubD=Slider(2, range=0..3),
    Execute=Toggle(False))
preview = CustomPreview(
    Geometry=refine,
    Shader={ambient=RGB(128, 128, 128), diffuse=RGB(0, 0, 0), emission=RGB(51, 111, 111), shine=0.25, specular=RGB(255, 255, 255), transparency=0})
