# Grasshopper definition coc_150722_PointAndBrep.gh (Grasshopper 0.9.76)
# plug-ins: MarchingCubes

crv = Curve([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])
pt = Point(Point(-40.83270625, 30.4528106, 21.19580445))
pt_2 = Point([Point(-40.83270625, 41.14856894, 21.19580445), Point(-40.83270625, 19.75705226, 21.19580445)])
point_charge = PointCharge(Point=pt, Radius=Slider(33.8, range=0..100), ChargeStrength=Slider(1.66, range=-2..2))
point_charge_2 = PointCharge(Point=pt_2, Radius=Slider(18.3, range=0..100), ChargeStrength=Slider(-2, range=-2..2))
brep_charge = BrepCharge(Brep=crv, Radius=Slider(4.5, range=0..20), ChargeStrengths=Slider(-1.6, range=-2..2))
merge = Merge(Data1=point_charge, Data2=point_charge_2, Data3=brep_charge)
cocoon = Cocoon(Charges=merge, Iso=Slider(0.25, range=0..1), CellSize=Slider(2.8, range=0.5..10), Execute=Toggle(True), Simple=False)  # -> Mesh, RefinementData
refine = Refine(
    RefinementData=cocoon.RefinementData,
    Samples=Slider(30, range=0..30),
    SampleSize=Slider(1, range=0..10),
    SampleTolerance="0.001",
    LaplacianSmoothing=Slider(3, range=0..10),
    ValencePasses=Slider(3, range=0..10),
    SubD=Slider(2, range=0..3),
    Execute=Toggle(True))
preview = CustomPreview(
    Geometry=refine,
    Shader={ambient=RGB(128, 128, 128), diffuse=RGB(0, 0, 0), emission=RGB(51, 111, 111), shine=0.25, specular=RGB(255, 255, 255), transparency=0})
