# Grasshopper definition coc_150722_SimpleCurveDriver.gh (Grasshopper 0.9.76)
# plug-ins: MarchingCubes

genes = GenePool(Decimals=2, Maximum=3, Minimum=1, Value=[2.07, 1.56, 1.21, 3, 1, 3])
crv = Curve(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)
curve_charge = CurveCharge(Curve=crv, Radius=Slider(13.6, range=1..20), ChargeStrengths=genes)
cocoon = Cocoon(
    Charges=curve_charge,
    Iso=Slider(0.7, range=0..1),
    CellSize=Slider(3.7, range=0.5..10),
    Execute=Toggle(True),
    Simple=False)  # -> Mesh, RefinementData
refine = Refine(
    RefinementData=cocoon.RefinementData,
    Samples=Slider(30, range=0..30),
    SampleSize=Slider(1, range=0..2),
    SampleTolerance="0.001",
    LaplacianSmoothing=Slider(5, range=0..10),
    ValencePasses=Slider(3, range=0..10),
    SubD=Slider(2, range=0..3),
    Execute=Toggle(True))
preview = CustomPreview(
    Geometry=refine,
    Shader={ambient=RGB(128, 128, 128), diffuse=RGB(0, 0, 0), emission=RGB(51, 111, 111), shine=0.25, specular=RGB(255, 255, 255), transparency=0})
